# Grasshopper definition 03-osm-blackplan.gh (Grasshopper 1.0.8)
# plug-ins: RhinoSpatial

# ----
# Spatial Context
button = Button()
spatial_context = SpatialContext(
    OpenMap=button,
    UseAbsoluteCoordinates=False,
    PersistedSelection_BoundingBox25832="477711.446,5550728.605,478013.830,5551126.120",
    PersistedSelection_BoundingBox25833="48839.247,5569759.545,49173.244,5570180.870",
    PersistedSelection_BoundingBox27700="1163530.756,78072.584,1163887.750,78511.007",
    PersistedSelection_BoundingBox3857="967176.798,6465070.192,967645.008,6465688.833",
    PersistedSelection_BoundingBox4283="8.688297,50.108401,8.692503,50.111965",
    PersistedSelection_BoundingBox4326="8.688297,50.108401,8.692503,50.111965",
    PersistedSelection_BoundingBox7844="8.688297,50.108401,8.692503,50.111965")

toggle = BooleanToggle(True)
load_osm = LoadOSM(SpatialContext=spatial_context, Buildings=True, Road=True, Water=toggle, Green=toggle, Rail=False)  # -> Buildings, Road, Water, Green, Rail, Status

preview = CustomPreview(Geometry=load_osm.Green, Material=ColourSwatch(SwatchColor=RGB(116, 156, 90)))
preview_2 = CustomPreview(Geometry=load_osm.Water, Material=ColourSwatch(SwatchColor=RGB(90, 133, 156)))
preview_3 = CustomPreview(Geometry=load_osm.Road, Material=ColourSwatch(SwatchColor=RGB(199, 199, 199)))
preview_4 = CustomPreview(Geometry=load_osm.Buildings, Material=ColourSwatch(SwatchColor=RGB(0, 0, 0)))
